# Grasshopper definition honeybee-ifc.gh (Grasshopper 1.0.7)
# plug-ins: Human

panel = Panel("C:\Users\devan\simulation\FamilyHouse_AC13.hbjson")
panel_2 = Panel("C:\Users\devan\simulation\BEM_Example_ArchiCAD.hbjson")
office_zones = Data([null x29])
house_zones = Data([null x19])
file = ReadFile(File="D:\Github\honeybee-ifc\honeybee_ifc\zone_storeys.py", PerLineParse=False)
roomattr = HBRoomAttributes({"Display Name": "display_name", "Simulation Name (Identifier)": "identifier", "Multiplier": "multiplier", "Story": "story", "Volume": "volume", "Gross Floor Area": "floor_area", "Exposed Area": "exposed_area", "Exterior Wall Area": "exterior_wall_area", "Exterior Aperture Area": "exterior_aperture_area", "Average Floor Elevation": "average_floor_height"}, selected="Display Name")
loadobjects = HBLoadObjects(hb_file="C:\Users\devan\simulation\SmallOffice_d_IFC2x3.hbjson", load=Toggle(True))  # -> report, hb_objs; plug-in component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
vizbytype = HBVisualizeByType(hb_objs=loadobjects.hb_objs)  # -> walls, interior_walls, roofs, ceilings, exterior_floors, interior_floors, air_walls, apertures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; plug-in component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
python = GhPythonScript(Code=file, Zones=house_zones, Floor="1")  # -> Out, Floors, Rooms
deconstructmodel = HBDeconstructModel(model=loadobjects.hb_objs)  # -> rooms, faces, apertures, doors, shades; plug-in component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
vizquick = HBVizualizeQuick(hb_objs=flatten(deconstructmodel.rooms))  # -> geo; plug-in component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
labelrooms = HBLabelRooms(rooms_model=flatten(python.Rooms), attribute=roomattr)  # -> label_text, base_pts, labels, wire_frame; plug-in component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
vizquick_2 = HBVizualizeQuick(hb_objs=flatten(deconstructmodel.apertures))  # -> geo; plug-in component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
vizquick_3 = HBVizualizeQuick(hb_objs=flatten(deconstructmodel.doors))  # -> geo; plug-in component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
vizquick_4 = HBVizualizeQuick(hb_objs=flatten(deconstructmodel.shades))  # -> geo; plug-in component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
wires = BrepWireframe(Brep=[vizquick, vizquick_4], Density=-1)
panel_3 = Panel(labelrooms.label_text)
python_2 = GhPythonScript(x=labelrooms.label_text)  # -> out, a; inputs x: list
# ---------- python_2: Python ----------
__author__ = "devan"
__version__ = "2021.10.05"

import rhinoscriptsyntax as rs
selected = ['Room_4b707274', 'Room_dbb9eb31', 'Room_f997b53b']
a = [item in selected for item in x]
# ---------- end python_2 ----------
dispatch = Dispatch(List=python.Rooms, DispatchPattern=python_2.a)  # -> ListA, ListB
preview = CustomPreview(Geometry=vizquick_2, Material=ColourSwatch(SwatchColor=RGB(0, 210, 255)))
preview_2 = CustomPreview(Geometry=vizquick_3, Material=ColourSwatch(SwatchColor=RGB(58, 0, 0)))
facen = FaceNormals(Mesh=vizquick_2)  # -> Centers, Normals
facen_2 = FaceNormals(Mesh=vizquick_3)  # -> Centers, Normals
list = ItemSelector(dispatch.ListA)
list_2 = ItemSelector(dispatch.ListA)
vdis = VectorDisplay(Anchor=facen.Centers, Vector=facen.Normals)
vdis_2 = VectorDisplay(Anchor=facen_2.Centers, Vector=facen_2.Normals)
geo = Geometry([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])
geo_2 = Geometry([<brep referenced from the Rhino model> x2])
roomsolid = HBRoomFromSolid(geo=flatten(geo), conditioned=True)  # -> report, rooms; plug-in component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
vizquick_5 = HBVizualizeQuick(hb_objs=flatten(dispatch.ListA))  # -> geo; plug-in component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
file_2 = ReadFile(File="D:\Github\honeybee-ifc\honeybee_ifc\close_gap.py", PerLineParse=False)
python_3 = GhPythonScript(Code=file_2, Rooms=python.Rooms)  # -> Out, A, Moved_rooms
panel_4 = Panel("""6.22,2.47,1.35
3.32,2.42,1.35
1.77,4.62,1.35
3.22,2.42,1.35
6.32,2.42,1.35
4.77,4.62,1.35""")
vizquick_6 = HBVizualizeQuick(hb_objs=flatten(python_3.Moved_rooms))  # -> geo; plug-in component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
pt = Point("1.77,4.62,1.35")
python_4 = GhPythonScript(x=python_3.Out)  # -> out, a; inputs x: list of Point3d
# ---------- python_4: Python ----------
__author__ = "devan"
__version__ = "2021.10.05"

import rhinoscriptsyntax as rs
def convert_to_rhino_points(points):
    return ['{}, {}, {}'.format(point.x, point.y, point.z) for point in points]

item = x[0]
item =item.split('(')
print(item)
a = convert_to_rhino_points(x)
# ---------- end python_4 ----------
bake = BakeGeometry(Bake=Button(), Geometry=vizquick_6, DeleteOldBakes=False, PreserveTrees=False)
wires_2 = BrepWireframe(Brep=vizquick_6, Density=-1)
preview_3 = CustomPreview(
    Geometry=vizquick_6,
    Material={diffuse=RGB(221, 160, 221), emission=RGB(66, 48, 66), shine=0.5, specular=RGB(255, 255, 255), transparency=0})
panel_5 = Panel(python_3.Out)
